# Grasshopper definition Agents_py_Dsub.gh (Grasshopper 0.9.76)
# plug-ins: Python Interpreter

display_trails = BooleanToggle(False)
wrap = BooleanToggle(False)
velocity = Slider(3.55, range=0..5)
num_agents = Slider(194, range=0..650)
alignment = Slider(5.45, range=0..10)
separation = Slider(7.32, range=0..10)
cohesion = Slider(1.64, range=0..10)
n_distance = Slider(10.3, range=0..50)
field_of_view = Slider(0.48, range=0..1)
# [Unblock GH Libraries] was written by Marios Tsiliakos on 15/08/2015 in grasshopper 0.9.0076
# This definition is for the pubic domain feel free to use it , share it and modify it, by providing proper citing. The author, Marios Tsiliakos of digitalsubstance.wordpress.com , makes no warranty, expressed or implied, as to the usefulness of the software and documentation for any purpose. If this tool is used for commercial purposes please notify the author. This work is licensed under a Creative Commons Attribution-Share Alike 3.0
# for more information visit digitalsubstance.wordpress.com.
srf = Surface(reparameterize(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))

# ----
# Run!!!!
reset_solution = BooleanToggle(False)

pi = Pi(Factor=field_of_view)
popgeo = PopulateGeometry(Geometry=srf, Count=num_agents, Seed=1)
bbox = BoundingBox(Content=srf, Plane=PlaneXY(0, 0, 0))  # -> Box, Box_2
timer = Timer(TimerInterval=20, Target=python)  # disabled
python = PythonScript(
    Agents_N=popgeo,
    Terrain=srf,
    Al_value=alignment,
    Se_value=separation,
    Co_value=cohesion,
    Velocity=velocity,
    N_distance=n_distance,
    N_angle=pi,
    Wrap=wrap,
    Display=display_trails,
    Reset=reset_solution)  # -> out, Agents_pos, Agents_View, Trails; inputs Agents_N: list of Point3d, Terrain: Surface, Display: Boolean, Reset: Boolean
# ---------- python: Python ----------
import Rhino
from math import*
import _random as rnd

# get a random number within a domain
def random_limits(lower,upper,r):
    randomlim = (upper -lower)*r + lower
    return randomlim
# get the agents initial positions
def initial_pos():
    l = 0.0
    u= 100.0
    j1 = (rnd.Random())
    x = random_limits(l,u,j1.random())
    y = random_limits(l,u,j1.random())
    z = random_limits(l,u,j1.random())
    pt = Rhino.Geometry.Point3d(x,y,z)
    return pt
#get the agents initial velocity
def random_vel():
    j = (rnd.Random())
    x = random_limits(0,100,j.random())
    y = random_limits(-1,100,j.random())
    z = random_limits(-1,100,j.random())
    vec_ran = Rhino.Geometry.Vector3d(x,y,z)
    return vec_ran
# limit vector
def lim_vec(v):
    if  v.Length >1:
        v.Unitize()
    return v

#////////////////////////Class constuctor//////////////
#.......Boid class 
class Boid(object):
    """ Custom Boid Class"""
    def __init__(self,Pos,Vel,Range,Vision,Alignment,Separation,Cohesion):
        self.pos = Pos
        self.vel = Vel
        self.ran = Range
        self.vis = Vision
        self.Al = Alignment
        self.Se = Separation
        self.Co = Cohesion
        
        initial_boids = Pos
        #New List to store the trails from the boids
        self.Boid_trail = []
        self.Boid_trail.append(initial_boids)
        
    def update(self,others):
        self.flocking(others)
        self.move()
        if Wrap == False:
            self.Boundary()
        elif Wrap == True:
            self.Boundary2()
 
        
    def move(self):
        t,u1,v1 = Terrain.ClosestPoint(self.pos)
        t1,pln = Terrain.FrameAt(u1,v1)
        xaxis = pln.XAxis
        ang1 = Rhino.Geometry.Vector3d.VectorAngle(self.vel,xaxis,pln)
        xaxis.Rotate(-ang1,pln.ZAxis)
        self.vel = xaxis
        self.pos = self.pos + (self.vel*Velocity)
        t,u2,v2 = Terrain.ClosestPoint(self.pos)
        self.pos = Terrain.PointAt(u2,v2)
        self.Boid_trail.append(self.pos)

    def Boundary(self):
        
        t,u,v = Terrain.ClosestPoint(self.pos)
        
        if u >= 1 or u <= 0 :
            self.vel[0] = -self.vel[0]
            self.vel[2] = -self.vel[2]
        if v >= 1 or v <= 0:
            self.vel[1] = -self.vel[1]
            self.vel[2] = -self.vel[2]

            
    def Boundary2(self):
        
        t,u,v = Terrain.ClosestPoint(self.pos)
        if u >= 1:
            self.pos = Terrain.PointAt(0,v)
        if u <= 0:
            self.pos = Terrain.PointAt(1,v)
        if v >= 1:
            self.pos = Terrain.PointAt(u,0)
        if v <= 0 :
            self.pos = Terrain.PointAt(u,1)


    def flocking(self,others):
        closer = self.Get_neighbors(others,self.ran,self.vis)
        cl_agents = closer[0]
        cl_distances = closer[1]
        if len(cl_agents)>0:
            b_acc = Rhino.Geometry.Vector3d(0.0,0.0,0.0)
            cl_center = self.Center(cl_agents)
            Al_vec = self.Align(cl_agents,cl_distances)
            Se_vec = self.Separate(cl_agents,cl_distances)
            Co_vec = self.Cohere(cl_agents)
            b_acc = b_acc+cl_center
            b_acc = b_acc+Al_vec
            b_acc = b_acc+Se_vec
            b_acc = b_acc+Co_vec
            self.vel = self.vel+b_acc
            self.vel = lim_vec(self.vel)

    def Align(self,others, o_dist):
        Al_steer = Rhino.Geometry.Vector3d(0.0,0.0,0.0)
        for i in range(len(others)):
            b = others[i]
            d = o_dist[i]
            if d >0 or d<0:
                dir = Rhino.Geometry.Vector3d
                dir =  b.vel*(self.ran/d)
                Al_steer =  Al_steer + dir
                Al_steer = lim_vec(Al_steer)
                Al_steer = Al_steer*self.Al
        return Al_steer
        
    def Separate(self,others, o_dist):
        desired_sep = 5.00
        Se_steer =Rhino.Geometry.Vector3d(0.0,0.0,0.0)
        for i in range(len(others)):
            b = others[i]
            d = o_dist[i]
            if d > 0 and d <= desired_sep:
                dir = Rhino.Geometry.Vector3d
                dir = self.pos - b.pos
                if d >0 or d<0:
                    dir =  b.vel*(self.ran/d)
                    if dir:
                        Se_steer =  Se_steer + dir
                        Se_steer = lim_vec(Se_steer)
                        Se_steer = Se_steer*self.Se
        return Se_steer
    
    def Cohere(self,others):
        Co_steer = Rhino.Geometry.Vector3d(0.0,0.0,0.0)
        for i in range(len(others)):
            b = others[i]
            Co_steer =Co_steer + b.pos
            Co_steer = Co_steer*(1/len(others))
            d = self.pos.DistanceTo(Co_steer)
            Co_steer = Co_steer-self.pos
            if d >0 or d<0:
                Co_steer = Co_steer*(self.ran/d)
                Co_steer = lim_vec(Co_steer)
                Co_steer = Co_steer*self.Co
        return Co_steer
    
    def Center(self,others):
        sumx,sumy,sumz = 0.0,0.0,0.0
        for other in others:
            n_pos = other.pos
            sumx += n_pos[0]
            sumy += n_pos[1]
            sumz += n_pos[2]
        for other in others:
            n_pos = other.pos
            if n_pos:
                center = Rhino.Geometry.Point3d(sumx/len(others),sumy/len(others),sumz/len(others))
                toward = Rhino.Geometry.Vector3d
                toward = center - n_pos
                toward = lim_vec(toward)
                return toward
            else:
                return Rhino.Geometry.Vector3d(0,0,0)

    def Get_neighbors(self,others,radius,angle):
        Nboidslist = []
        Nboids_dist = []
        for other in others :
            if other is self: 
                continue
            dist = Rhino.Geometry.Vector3d
            dist =  other.pos - self.pos
            orient = Rhino.Geometry.Vector3d.VectorAngle(((self.pos+self.vel)-self.pos),dist)
            distance= dist.Length
            if distance <radius and orient < angle :
                Nboidslist.append(other)
                Nboids_dist.append(distance)
        return Nboidslist,Nboids_dist

def Agents_Init(n):
    Boids_population=[]#agent population list

    for i in range(len(n)):
        #instantiate the boid class
        #float(u0)
        #float(v0)
        pos_init= n[i]
        t,u0,v0 = Terrain.ClosestPoint(pos_init)
        pos_init = Terrain.PointAt(u0,v0)
        #print pos_init
        vec_init = random_vel()
        #print vec_init
        Boids_population.append(Boid(pos_init,vec_init,N_distance,N_angle,Al_value,Se_value,Co_value))
    return Boids_population

def Agents_run(Boids_population):
    for boid in Boids_population:
        
        #Make global variable local and dynamic
        boid.Al = Al_value
        boid.Se = Se_value
        boid.Co = Co_value
        boid.vis = N_angle 
        boid.ran = N_distance 
        
        boid.update(Boids_population)
        agent_pts.append(boid.pos) 
        agents_v.append(boid.vel)
        if len(boid.Boid_trail)>3 and Display == True:
            crv = Rhino.Geometry.Curve.CreateInterpolatedCurve(boid.Boid_trail,3)
            agent_crvs.append(crv)




# main routine

if Reset == True:
    agent_pts = []
    agent_crvs = []
    agents_v = []

    if Initial_Boids:
        Agents_run(Initial_Boids)
        counter += 1
        print counter
    else:
        Initial_Boids = Agents_Init(Agents_N)
        print len(agent_pts),"flocking agents"
    Agents_pos = agent_pts
    Trails = agent_crvs
    Agents_View = agents_v

elif Reset == False:
    print("Idle")
    Initial_Boids= []
    counter = 0
# ---------- end python ----------
debox = DeconstructBox(Box=bbox.Box)  # -> Plane, X, Y, Z

# ---- group: outputs
crv = Curve(python.Trails)
pt = Point(python.Agents_pos)
vdis = VectorDisplay(Anchor=python.Agents_pos, Vector=python.Agents_View)

# ----
number_slider = Slider(255, range=0..1000)
runtimes = Panel(python.out)
pdecon = Deconstruct(Point=python.Agents_pos)  # -> XComponent, YComponent, ZComponent
remap = RemapNumbers(Value=pdecon.XComponent, Source=debox.X, Target=number_slider)  # -> Mapped, Clipped
remap_2 = RemapNumbers(Value=pdecon.YComponent, Source=debox.Y, Target=number_slider)  # -> Mapped, Clipped
remap_3 = RemapNumbers(Value=pdecon.ZComponent, Source=debox.Z, Target=number_slider)  # -> Mapped, Clipped
rgb = ColourRGB(Alpha=255, Red=remap.Mapped, Green=remap_2.Mapped, Blue=remap_3.Mapped)
preview = CustomPreview(Geometry=pt, Shader=rgb)
